# Dynamo graph DesignScript.dyn (Dynamo 2.18.1.5096)

# group: Design Script
boolean = BoolSelector(false)
python_script = Python(IN[0]=boolean)  # IronPython2
# ---------- python_script.python (4 lines) ----------
#f = open(r"U:\17_TrainingAdvanceDynamo\2_WORKING\Tool\Dynamo\Training-Dynamo-2024\DesignScript.py", "r")
f = open(r"A:\Library-Dynamo-Python-CSharp\test.py")
#f = open(r"A:\Library-Dynamo-Python-CSharp\test.py", "r")
OUT = f.read() 
# ----------------------------------------
python_script_from_string = PythonStringNode(script=python_script)  # IronPython2; unwired: IN[0]
